# Grasshopper definition BuildingMassing.gh (Grasshopper 1.0.7)
# plug-ins: BH.UI.Grasshopper

# Empty string for value defines a search for all types of building
# Relation can pick up buildings with mutliple footprints holes etc
panel = Panel("")
node = Node(Latitude=Slider(51.51334, range=0..100), Longitude=Slider(-0.0881, range=-180..10), Component="{ .Node")
createdictionary = CreateDictionary(Keys="building", Values=panel, Component="{ .CreateDictionary")
centreradius = CentreRadius(Centre=node, Radius=Slider(1000, range=0..1000), Component="BH.oM.OpenStreetMap.CentreRadius")
way = Way(Keyvalues=createdictionary, Component="{ .Way")
relation = Relation(Keyvalues=createdictionary, Component="{ .Relation")
querybuilder = QueryBuilder(Region=centreradius, Elements=[way, relation], Component="{ .QueryBuilder")
explode = Explode(Object=querybuilder, Component="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")  # -> QueryString, BHoM_Guid, Name, Fragments, Tags, CustomData

# ----
# this can be slow
getrequest = GetRequest(Uri=explode.QueryString, Component="{ .GetRequest")  # disabled

toelementcontainer = ToElementContainer(OpenStreetMapQueryJSONResult=getrequest, Component="{ .ToElementContainer")
explode_2 = Explode(Object=toelementcontainer, Component="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")  # -> Nodes, Ways, BHoM_Guid, Name, Fragments, Tags, CustomData
explode_3 = Explode(Object=explode_2.Ways, Component="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")  # -> Nodes, OsmID, NodeOsmIds, KeyValues, BHoM_Guid, Name, Fragments, Tags, CustomData
toutmpolyline = ToUTMPolyline(Way=explode_2.Ways, Component="{ .ToUTMPolyline")
getproperty = GetProperty(Obj=explode_3.KeyValues, PropName="building:levels", Component="{ .GetProperty")
crv = Curve(toutmpolyline)
multiplication = Multiplication(A=Slider(4, range=0..10), B=getproperty)
null = NullItem(Item=getproperty)  # -> NullFlags, InvalidFlags, Description
Z = UnitZ(Factor=multiplication)
number_slider = Slider(124, range=0..1000)
extr = Extrude(Base=crv, Direction=Z)
rgb = ColourRGB(Alpha=255, Red=number_slider, Green=number_slider, Blue=number_slider)
cap = CapHoles(Brep=extr)  # disabled
preview = CustomPreview(Geometry=cap, Material=rgb)
