# Grasshopper definition ConvertCoords.gh (Grasshopper 1.0.7)
# plug-ins: BH.UI.Grasshopper

# Look up utm zone: http://www.dmap.co.uk/utmworld.htm
node = Node(Latitude="53.340167", Longitude="-6.266531", Component="{ .Node")
toutmpoint = ToUTMPoint(Node=node, Component="{ .ToUTMPoint")
toutmzone = ToUTMZone(Longitude="-6.266531", Component="{ .ToUTMZone")
pdecon = Deconstruct(Point=toutmpoint)  # -> XComponent, YComponent, ZComponent
tolatlonnode = ToLatLonNode(Utmpoint=toutmpoint, Zone=toutmzone, SouthernHemi=Toggle(False), Component="{ .ToLatLonNode")
panel = Panel(pdecon.YComponent)
panel_2 = Panel(pdecon.XComponent)
explode = Explode(Object=tolatlonnode, Component="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")  # -> Latitude, Longitude, OsmID, KeyValues, BHoM_Guid, Name, Fragments, Tags, CustomData
panel_3 = Panel(explode.Latitude)
panel_4 = Panel(explode.Longitude)
