# Grasshopper definition FindElementByID.gh (Grasshopper 1.0.7)
# plug-ins: BH.UI.Grasshopper

createdictionary = CreateDictionary(Component="{ .CreateDictionary")
way = Way(Keyvalues=createdictionary, Component="{ .Way")
relation = Relation(
    OsmID=Slider(1000, range=0..1000),
    KeyValues="BH.Engine.Grasshopper.Objects.GH_Dictionary",
    Component="BH.oM.OpenStreetMap.Relation")
relation_2 = Relation(Keyvalues=createdictionary, Component="BH.oM.OpenStreetMap.Relation")
way_2 = Way(
    OsmID=Slider(10000000, range=0..10000000),
    KeyValues="BH.Engine.Grasshopper.Objects.GH_Dictionary",
    Component="BH.oM.OpenStreetMap.Way")
querybuilder = QueryBuilder(OsmID="47086748", Element=way, Component="{ .QueryBuilder")
explode = Explode(Object=querybuilder, Component="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")  # -> QueryString, BHoM_Guid, Name, Fragments, Tags, CustomData
panel = Panel(explode.QueryString)
getrequest = GetRequest(Uri=explode.QueryString, Component="{ .GetRequest")  # disabled
toelementcontainer = ToElementContainer(OpenStreetMapQueryJSONResult=getrequest, Component="{ .ToElementContainer")
explode_2 = Explode(Object=toelementcontainer, Component="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")  # -> Nodes, Ways, BHoM_Guid, Name, Fragments, Tags, CustomData
toutmpolyline = ToUTMPolyline(Way=explode_2.Ways, Component="{ .ToUTMPolyline")
createcustom = CreateCustom(VenueName="AT&T Stadium", Ways=explode_2.Ways, Component="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")
tojson = ToJson(Obj=createcustom, Component="{ .ToJson")
panel_2 = Panel(tojson)
