# Grasshopper definition SearchBoundingBox2.gh (Grasshopper 1.0.7)
# plug-ins: BH.UI.Grasshopper

createdictionary = CreateDictionary(Keys="name", Values="Bath", Component="{ .CreateDictionary")
# Find the admin boundary of Bath within a bounding box
# Good place for finding the boundary values is https://www.openstreetmap.org/ and click export
number_slider = Slider(51.4281, range=0..100)
relation = Relation(Keyvalues=createdictionary, Component="{ .Relation")
boundingbox = BoundingBox(
    North=number_slider,
    South=Slider(51.3336, range=0..100),
    East=Slider(-2.2302, range=-180..1),
    West=Slider(-2.4997, range=-180..1),
    Component="BH.oM.OpenStreetMap.BoundingBox")
querybuilder = QueryBuilder(Region=boundingbox, Elements=relation, Component="{ .QueryBuilder")
explode = Explode(Object=querybuilder, Component="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")  # -> QueryString, BHoM_Guid, Name, Fragments, Tags, CustomData
httpadapter = HTTPAdapter(Component="{ ..ctor")

getrequest = GetRequest(BaseUrl=explode.QueryString, Component="{ .GetRequest")
pull = Pull(
    Adapter=httpadapter,
    Request=getrequest,
    PullType="{ \"_t\" : \"System.Enum\", \"TypeName\" : { \"_t\" : \"System.Type\", \"Name\" : \"BH.oM.Adapter.PullType\" }, \"Value\" : \"AdapterDefault\" }",
    Active=Toggle(False),
    Component="{ .Pull")

toelementcontainer = ToElementContainer(QueryResults=pull, Component="{ .ToElementContainer")
explode_2 = Explode(Object=toelementcontainer, Component="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")  # -> Nodes, Ways, Relations, BHoM_Guid, Name, Fragments, Tags, CustomData
toutmpolyline = ToUTMPolyline(Way=explode_2.Ways, GridZone=0, Component="{ .ToUTMPolyline")
