# Grasshopper definition SearchInPolygon.gh (Grasshopper 1.0.7)
# plug-ins: BH.UI.Grasshopper

# ----
# Find utm zone for Dublin
panel = Panel("-6.266155")
toutmzone = ToUTMZone(Longitude=panel, Component="{ .ToUTMZone")

# ----
# To get an understanding of OpenStreet Map see: https://wiki.openstreetmap.org/wiki/Map_Features
# Searching for trees and footpaths in a Polygon within Dublin
crv = Curve(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)
createdictionary = CreateDictionary(Keys="highway", Values="footway", Component="{ .CreateDictionary")
createdictionary_2 = CreateDictionary(Keys="natural", Values="tree", Component="{ .CreateDictionary")
icontrolpoints = IControlPoints(Curve=crv, Component="{ .IControlPoints")
tolatlonnode = ToLatLonNode(Utmpoint=icontrolpoints, Zone=toutmzone, SouthernHemi=Toggle(False), Component="{ .ToLatLonNode")
way = Way(Keyvalues=createdictionary, Component="{ .Way")
node = Node(Keyvalues=createdictionary_2, Component="{ .Node")
polygon = Polygon(Nodes=tolatlonnode, Component="BH.oM.OpenStreetMap.Polygon")
querybuilder = QueryBuilder(Region=polygon, Elements=way, Component="{ .QueryBuilder")
querybuilder_2 = QueryBuilder(Region=polygon, Elements=node, Component="{ .QueryBuilder")
explode = Explode(Object=querybuilder_2, Component="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")  # -> QueryString, BHoM_Guid, Name, Fragments, Tags, CustomData
explode_2 = Explode(Object=querybuilder, Component="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")  # -> QueryString, BHoM_Guid, Name, Fragments, Tags, CustomData
httpadapter = HTTPAdapter(Component="{ ..ctor")

getrequest = GetRequest(BaseUrl=explode.QueryString, Component="{ .GetRequest")
pull = Pull(
    Adapter=httpadapter,
    Request=getrequest,
    PullType="{ \"_t\" : \"System.Enum\", \"TypeName\" : { \"_t\" : \"System.Type\", \"Name\" : \"BH.oM.Adapter.PullType\" }, \"Value\" : \"AdapterDefault\" }",
    Active=Toggle(True),
    Component="{ .Pull")

getrequest_2 = GetRequest(BaseUrl=explode_2.QueryString, Component="{ .GetRequest")
pull_2 = Pull(
    Adapter=httpadapter,
    Request=getrequest_2,
    PullType="{ \"_t\" : \"System.Enum\", \"TypeName\" : { \"_t\" : \"System.Type\", \"Name\" : \"BH.oM.Adapter.PullType\" }, \"Value\" : \"AdapterDefault\" }",
    Active=Toggle(True),
    Component="{ .Pull")

toelementcontainer = ToElementContainer(QueryResults=pull, Component="{ .ToElementContainer")
toelementcontainer_2 = ToElementContainer(QueryResults=pull_2, Component="{ .ToElementContainer")
explode_3 = Explode(Object=toelementcontainer, Component="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")  # -> Nodes, Ways, Relations, BHoM_Guid, Name, Fragments, Tags, CustomData
explode_4 = Explode(Object=toelementcontainer_2, Component="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")  # -> Nodes, Ways, Relations, BHoM_Guid, Name, Fragments, Tags, CustomData
toutmpolyline = ToUTMPolyline(Way=explode_4.Ways, GridZone=0, Component="{ .ToUTMPolyline")
toutmpoint = ToUTMPoint(Node=explode_3.Nodes, Component="{ .ToUTMPoint")
