# Grasshopper definition SearchTaggedArea.gh (Grasshopper 1.0.7)
# plug-ins: BH.UI.Grasshopper

# Find the universities within the OSM area tagged as Bath
panel = Panel("name")
createdictionary = CreateDictionary(Keys=panel, Values="Bath", Component="{ .CreateDictionary")
createdictionary_2 = CreateDictionary(Keys="building", Values="university", Component="{ .CreateDictionary")
relation = Relation(Keyvalues=createdictionary_2, Component="{ .Relation")
way = Way(Keyvalues=createdictionary_2, Component="{ .Way")
taggedarea = TaggedArea(KeyValues=createdictionary, Component="BH.oM.OpenStreetMap.TaggedArea")
querybuilder = QueryBuilder(Region=taggedarea, Elements=[relation, way], Component="{ .QueryBuilder")
explode = Explode(Object=querybuilder, Component="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")  # -> QueryString, BHoM_Guid, Name, Fragments, Tags, CustomData
httpadapter = HTTPAdapter(Component="{ ..ctor")

getrequest = GetRequest(BaseUrl=explode.QueryString, Component="{ .GetRequest")
pull = Pull(
    Adapter=httpadapter,
    Request=getrequest,
    PullType="{ \"_t\" : \"System.Enum\", \"TypeName\" : { \"_t\" : \"System.Type\", \"Name\" : \"BH.oM.Adapter.PullType\" }, \"Value\" : \"AdapterDefault\" }",
    Active=Toggle(False),
    Component="{ .Pull")

toelementcontainer = ToElementContainer(QueryResults=pull, Component="{ .ToElementContainer")
explode_2 = Explode(Object=toelementcontainer, Component="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")  # -> Nodes, Ways, Relations, BHoM_Guid, Name, Fragments, Tags, CustomData
toutmpolyline = ToUTMPolyline(Way=explode_2.Ways, GridZone=0, Component="{ .ToUTMPolyline")
