# Grasshopper definition ToUTMPolylineWithZoneOverride.gh (Grasshopper 1.0.7)
# plug-ins: BH.UI.Grasshopper

createdictionary = CreateDictionary(Keys="name", Values="'M25 motorway'", Component="{ .CreateDictionary")
boundingbox = BoundingBox(
    North=Slider(51.8629, range=0..100),
    South=Slider(51.1087, range=0..100),
    East=Slider(0.9531, range=-180..1),
    West=Slider(-1.203, range=-180..1),
    Component="BH.oM.OpenStreetMap.BoundingBox")
relation = Relation(Keyvalues=createdictionary, Component="{ .Relation")
querybuilder = QueryBuilder(Region=boundingbox, Elements=relation, Component="{ .QueryBuilder")
# Good place for finding the boundary values is https://www.openstreetmap.org/ and click export
explode = Explode(Object=querybuilder, Component="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")  # -> QueryString, BHoM_Guid, Name, Fragments, Tags, CustomData
httpadapter = HTTPAdapter(Component="{ ..ctor")

getrequest = GetRequest(BaseUrl=explode.QueryString, Component="{ .GetRequest")
pull = Pull(
    Adapter=httpadapter,
    Request=getrequest,
    PullType="{ \"_t\" : \"System.Enum\", \"TypeName\" : { \"_t\" : \"System.Type\", \"Name\" : \"BH.oM.Adapter.PullType\" }, \"Value\" : \"AdapterDefault\" }",
    Active=Toggle(False),
    Component="{ .Pull")

toelementcontainer = ToElementContainer(QueryResults=pull, Component="{ .ToElementContainer")
explode_2 = Explode(Object=toelementcontainer, Component="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")  # -> Nodes, Ways, Relations, BHoM_Guid, Name, Fragments, Tags, CustomData
# Get the average UTM zone from all ways - M25 spans 2 zones
toutmzone = ToUTMZone(Ways=explode_2.Ways, Component="{ .ToUTMZone")
toutmpolyline = ToUTMPolyline(Way=explode_2.Ways, GridZone=toutmzone, Component="{ .ToUTMPolyline")
