# Grasshopper definition M25.gh (Grasshopper 1.0.7)
# plug-ins: BH.UI.Grasshopper

# Good place for the boundary values is https://www.openstreetmap.org/ and click export
number_slider = Slider(51.8629, range=0..100)
createdictionary = CreateDictionary(Keys="name", Values="'M25 motorway'", Component="{ .CreateDictionary")
relation = Relation(Keyvalues=createdictionary, Component="BH.oM.OpenStreetMap.Relation")
boundingbox = BoundingBox(
    North=number_slider,
    South=Slider(51.1087, range=0..100),
    East=Slider(0.9531, range=-180..1),
    West=Slider(-1.203, range=-180..1),
    Component="BH.oM.OpenStreetMap.BoundingBox")
querybuilder = QueryBuilder(Region=boundingbox, Elements=relation, Component="{ .QueryBuilder")
explode = Explode(Object=querybuilder, Component="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")  # -> QueryString, BHoM_Guid, Name, Fragments, Tags, CustomData
getrequest = GetRequest(Uri=explode.QueryString, Component="{ .GetRequest")
toelementcontainer = ToElementContainer(OpenStreetMapQueryJSONResult=getrequest, Component="{ .ToElementContainer")
explode_2 = Explode(Object=toelementcontainer, Component="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")  # -> Nodes, Ways, BHoM_Guid, Name, Fragments, Tags, CustomData
toutmzone = ToUTMZone(Ways=explode_2.Ways, Component="{ .ToUTMZone")
toutmpolyline = ToUTMPolyline(Way=explode_2.Ways, GridZone=toutmzone, Component="{ .ToUTMPolyline")
