# Grasshopper definition SearchBoundingBox.gh (Grasshopper 1.0.7)
# plug-ins: BH.UI.Grasshopper

# Empty value will search for all highway types
panel = Panel("building")
# Stadiums in OSM are often Relations with the inner and outer roof lines
panel_2 = Panel("leisure")
# Searching within Bounding Box around Tottenham Hotspur
# Good place for the boundary values is https://www.openstreetmap.org/ and click export
number_slider = Slider(51.6155, range=0..100)
createdictionary = CreateDictionary(Keys=panel, Values="stadium", Component="{ .CreateDictionary")
createdictionary_2 = CreateDictionary(Keys=panel_2, Values="park", Component="{ .CreateDictionary")
createdictionary_3 = CreateDictionary(Keys="highway", Component="{ .CreateDictionary")
relation = Relation(Keyvalues=createdictionary, Component="BH.oM.OpenStreetMap.Relation")
way = Way(Keyvalues=createdictionary_2, Component="BH.oM.OpenStreetMap.Way")
way_2 = Way(Keyvalues=createdictionary_3, Component="BH.oM.OpenStreetMap.Way")
boundingbox = BoundingBox(
    North=number_slider,
    South=Slider(51.5933, range=0..100),
    East=Slider(-0.0279, range=-180..1),
    West=Slider(-0.0953, range=-180..1),
    Component="BH.oM.OpenStreetMap.BoundingBox")
querybuilder = QueryBuilder(Region=boundingbox, Elements=way, Component="{ .QueryBuilder")
querybuilder_2 = QueryBuilder(Region=boundingbox, Elements=way_2, Component="{ .QueryBuilder")
querybuilder_3 = QueryBuilder(Region=boundingbox, Elements=relation, Component="{ .QueryBuilder")
explode = Explode(Object=querybuilder_2, Component="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")  # -> QueryString, BHoM_Guid, Name, Fragments, Tags, CustomData
explode_2 = Explode(Object=querybuilder_3, Component="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")  # -> QueryString, BHoM_Guid, Name, Fragments, Tags, CustomData
explode_3 = Explode(Object=querybuilder, Component="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")  # -> QueryString, BHoM_Guid, Name, Fragments, Tags, CustomData
httpadapter = HTTPAdapter(Component="{ ..ctor")

getrequest = GetRequest(BaseUrl=explode.QueryString, Component="{ .GetRequest")
pull = Pull(
    Adapter=httpadapter,
    Request=getrequest,
    PullType="{ \"_t\" : \"System.Enum\", \"TypeName\" : { \"_t\" : \"System.Type\", \"Name\" : \"BH.oM.Adapter.PullType\" }, \"Value\" : \"AdapterDefault\" }",
    Active=Toggle(False),
    Component="{ .Pull")

getrequest_2 = GetRequest(BaseUrl=explode_2.QueryString, Component="{ .GetRequest")
pull_2 = Pull(
    Adapter=httpadapter,
    Request=getrequest_2,
    PullType="{ \"_t\" : \"System.Enum\", \"TypeName\" : { \"_t\" : \"System.Type\", \"Name\" : \"BH.oM.Adapter.PullType\" }, \"Value\" : \"AdapterDefault\" }",
    Active=Toggle(True),
    Component="{ .Pull")

getrequest_3 = GetRequest(BaseUrl=explode_3.QueryString, Component="{ .GetRequest")
pull_3 = Pull(
    Adapter=httpadapter,
    Request=getrequest_3,
    PullType="{ \"_t\" : \"System.Enum\", \"TypeName\" : { \"_t\" : \"System.Type\", \"Name\" : \"BH.oM.Adapter.PullType\" }, \"Value\" : \"AdapterDefault\" }",
    Active=Toggle(True),
    Component="{ .Pull")

toelementcontainer = ToElementContainer(QueryResults=pull, Component="{ .ToElementContainer")
toelementcontainer_2 = ToElementContainer(QueryResults=pull_2, Component="{ .ToElementContainer")
toelementcontainer_3 = ToElementContainer(QueryResults=pull_3, Component="{ .ToElementContainer")
explode_4 = Explode(Object=toelementcontainer_3, Component="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")  # -> Nodes, Ways, Relations, BHoM_Guid, Name, Fragments, Tags, CustomData
explode_5 = Explode(Object=toelementcontainer, Component="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")  # -> Nodes, Ways, Relations, BHoM_Guid, Name, Fragments, Tags, CustomData
explode_6 = Explode(Object=toelementcontainer_2, Component="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")  # -> Nodes, Ways, Relations, BHoM_Guid, Name, Fragments, Tags, CustomData
toutmpolyline = ToUTMPolyline(Way=explode_4.Ways, GridZone=0, Component="{ .ToUTMPolyline")
toutmpolyline_2 = ToUTMPolyline(Way=explode_6.Ways, GridZone=0, Component="{ .ToUTMPolyline")
toutmpolyline_3 = ToUTMPolyline(Way=explode_5.Ways, GridZone=0, Component="{ .ToUTMPolyline")
curve = Curve(toutmpolyline)
boundary_surfaces = BoundarySurfaces(Edges=curve)
