# Grasshopper definition SearchBoundingBox2.gh (Grasshopper 1.0.7)
# plug-ins: BH.UI.Grasshopper

# Find the universities within the OSM area tagged as Bath
panel = Panel("name")
# Find the parks within the OSM area tagged as Bath
panel_2 = Panel("leisure")
# Find the admin boundary of Bath within a bounding box
number_slider = Slider(51.4281, range=0..100)
createdictionary = CreateDictionary(Keys="building", Values="university", Component="{ .CreateDictionary")
createdictionary_2 = CreateDictionary(Keys=panel, Values="Bath", Component="{ .CreateDictionary")
createdictionary_3 = CreateDictionary(Keys=panel_2, Values="park", Component="{ .CreateDictionary")
relation = Relation(Keyvalues=createdictionary_2, Component="{ .Relation")
relation_2 = Relation(Keyvalues=createdictionary, Component="{ .Relation")
way = Way(Keyvalues=createdictionary, Component="{ .Way")
relation_3 = Relation(Keyvalues=createdictionary_3, Component="{ .Relation")
way_2 = Way(Keyvalues=createdictionary_3, Component="{ .Way")
taggedarea = TaggedArea(KeyValues=createdictionary_2, Component="BH.oM.OpenStreetMap.TaggedArea")
boundingbox = BoundingBox(
    North=number_slider,
    South=Slider(51.3336, range=0..100),
    East=Slider(-2.2302, range=-180..1),
    West=Slider(-2.4997, range=-180..1),
    Component="BH.oM.OpenStreetMap.BoundingBox")
querybuilder = QueryBuilder(Region=taggedarea, Elements=[way, relation_2], Component="{ .QueryBuilder")
querybuilder_2 = QueryBuilder(Region=boundingbox, Elements=relation, Component="{ .QueryBuilder")
querybuilder_3 = QueryBuilder(Region=taggedarea, Elements=[way_2, relation_3], Component="{ .QueryBuilder")
explode = Explode(Object=querybuilder_2, Component="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")  # -> QueryString, BHoM_Guid, Name, Fragments, Tags, CustomData
explode_2 = Explode(Object=querybuilder, Component="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")  # -> QueryString, BHoM_Guid, Name, Fragments, Tags, CustomData
explode_3 = Explode(Object=querybuilder_3, Component="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")  # -> QueryString, BHoM_Guid, Name, Fragments, Tags, CustomData

getrequest = GetRequest(Uri=explode.QueryString, Component="{ .GetRequest")  # disabled
getrequest_2 = GetRequest(Uri=explode_2.QueryString, Component="{ .GetRequest")  # disabled
getrequest_3 = GetRequest(Uri=explode_3.QueryString, Component="{ .GetRequest")  # disabled

elementcontainer = ElementContainer(OSMQueryJSONResult=getrequest_2, Component="{ .ElementContainer")
elementcontainer_2 = ElementContainer(OSMQueryJSONResult=getrequest, Component="{ .ElementContainer")
elementcontainer_3 = ElementContainer(OSMQueryJSONResult=getrequest_3, Component="{ .ElementContainer")
explode_4 = Explode(Object=elementcontainer_2, Component="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")  # -> Nodes, Ways, BHoM_Guid, Name, Fragments, Tags, CustomData
explode_5 = Explode(Object=elementcontainer, Component="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")  # -> Nodes, Ways, BHoM_Guid, Name, Fragments, Tags, CustomData
explode_6 = Explode(Object=elementcontainer_3, Component="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")  # -> Nodes, Ways, BHoM_Guid, Name, Fragments, Tags, CustomData
waytoutmpolyline = WayToUTMPolyline(Way=explode_5.Ways, Component="{ .WayToUTMPolyline")
waytoutmpolyline_2 = WayToUTMPolyline(Way=explode_4.Ways, Component="{ .WayToUTMPolyline")
waytoutmpolyline_3 = WayToUTMPolyline(Way=explode_6.Ways, Component="{ .WayToUTMPolyline")
boundary_surfaces = BoundarySurfaces(Edges=waytoutmpolyline_3)
