# Grasshopper definition SearchCentreRadius.gh (Grasshopper 1.0.7)
# plug-ins: BH.UI.Grasshopper

# Searching around the Aviva Stadium for bars,pubs and cafes plus all kinds of highway
number_slider = Slider(53.3352318, range=0..100)
# Full OSM feature list https://wiki.openstreetmap.org/wiki/Map_Features
number_slider_2 = Slider(-6.228456, range=-180..10)
number_slider_3 = Slider(1000, range=0..1000)
# Empty string for value defines a search for all types of highway
panel = Panel("leisure")
# Searching here for the same tags in both Way and Relation
panel_2 = Panel("stadium")
node = Node(Latitude=number_slider, Longitude=number_slider_2, Component="BH.oM.OpenStreetMap.Node")
createdictionary = CreateDictionary(Keys=panel, Values=panel_2, Component="{ .CreateDictionary")
createdictionary_2 = CreateDictionary(Keys="amenity", Values="bar", Component="{ .CreateDictionary")
createdictionary_3 = CreateDictionary(Keys="amenity", Values="pub", Component="{ .CreateDictionary")
createdictionary_4 = CreateDictionary(Keys="amenity", Values="cafe", Component="{ .CreateDictionary")
createdictionary_5 = CreateDictionary(Keys="highway", Component="{ .CreateDictionary")
toutmpoint = ToUTMPoint(Node=node, Component="{ .ToUTMPoint")
centreradius = CentreRadius(Centre=node, Radius=number_slider_3, Component="BH.oM.OpenStreetMap.CentreRadius")
point = Point(toutmpoint)
relation = Relation(Keyvalues=createdictionary, Component="BH.oM.OpenStreetMap.Relation")
node_2 = Node(Keyvalues=[createdictionary_3, createdictionary_4, createdictionary_2], Component="BH.oM.OpenStreetMap.Node")
way = Way(Keyvalues=createdictionary_5, Component="BH.oM.OpenStreetMap.Way")
way_2 = Way(Keyvalues=createdictionary, Component="BH.oM.OpenStreetMap.Way")
circle = Circle(Plane=point, Radius=number_slider_3)
querybuilder = QueryBuilder(Region=centreradius, Elements=node_2, Component="{ .QueryBuilder")
querybuilder_2 = QueryBuilder(Region=centreradius, Elements=way, Component="{ .QueryBuilder")
querybuilder_3 = QueryBuilder(Region=centreradius, Elements=[way_2, relation], Component="{ .QueryBuilder")
explode = Explode(Object=querybuilder, Component="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")  # -> QueryString, BHoM_Guid, Name, Fragments, Tags, CustomData
explode_2 = Explode(Object=querybuilder_3, Component="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")  # -> QueryString, BHoM_Guid, Name, Fragments, Tags, CustomData
explode_3 = Explode(Object=querybuilder_2, Component="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")  # -> QueryString, BHoM_Guid, Name, Fragments, Tags, CustomData
httpadapter = HTTPAdapter(Component="{ ..ctor")

getrequest = GetRequest(BaseUrl=explode.QueryString, Component="{ .GetRequest")
pull = Pull(
    Adapter=httpadapter,
    Request=getrequest,
    PullType="{ \"_t\" : \"System.Enum\", \"TypeName\" : { \"_t\" : \"System.Type\", \"Name\" : \"BH.oM.Adapter.PullType\" }, \"Value\" : \"AdapterDefault\" }",
    Active=Toggle(False),
    Component="{ .Pull")

getrequest_2 = GetRequest(BaseUrl=explode_3.QueryString, Component="{ .GetRequest")
pull_2 = Pull(
    Adapter=httpadapter,
    Request=getrequest_2,
    PullType="{ \"_t\" : \"System.Enum\", \"TypeName\" : { \"_t\" : \"System.Type\", \"Name\" : \"BH.oM.Adapter.PullType\" }, \"Value\" : \"AdapterDefault\" }",
    Active=Toggle(False),
    Component="{ .Pull")

getrequest_3 = GetRequest(BaseUrl=explode_2.QueryString, Component="{ .GetRequest")
pull_3 = Pull(
    Adapter=httpadapter,
    Request=getrequest_3,
    PullType="{ \"_t\" : \"System.Enum\", \"TypeName\" : { \"_t\" : \"System.Type\", \"Name\" : \"BH.oM.Adapter.PullType\" }, \"Value\" : \"AdapterDefault\" }",
    Active=Toggle(False),
    Component="{ .Pull")

toelementcontainer = ToElementContainer(QueryResults=pull, Component="{ .ToElementContainer")
toelementcontainer_2 = ToElementContainer(QueryResults=pull_2, Component="{ .ToElementContainer")
toelementcontainer_3 = ToElementContainer(QueryResults=pull_3, Component="{ .ToElementContainer")
explode_4 = Explode(Object=toelementcontainer, Component="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")  # -> Nodes, Ways, Relations, BHoM_Guid, Name, Fragments, Tags, CustomData
explode_5 = Explode(Object=toelementcontainer_2, Component="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")  # -> Nodes, Ways, Relations, BHoM_Guid, Name, Fragments, Tags, CustomData
explode_6 = Explode(Object=toelementcontainer_3, Component="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")  # -> Nodes, Ways, Relations, BHoM_Guid, Name, Fragments, Tags, CustomData
toutmpoint_2 = ToUTMPoint(Node=explode_4.Nodes, Component="{ .ToUTMPoint")
toutmpolyline = ToUTMPolyline(Way=explode_6.Ways, GridZone=0, Component="{ .ToUTMPolyline")
explode_7 = Explode(Object=explode_6.Ways, Component="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")  # -> Nodes, OsmID, NodeOsmIds, KeyValues, BHoM_Guid, Name, Fragments, Tags, CustomData
toutmpolyline_2 = ToUTMPolyline(Way=explode_5.Ways, GridZone=0, Component="{ .ToUTMPolyline")
explode_8 = Explode(Object=explode_4.Nodes, Component="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")  # -> Latitude, Longitude, OsmID, KeyValues, BHoM_Guid, Name, Fragments, Tags, CustomData
point_2 = Point(toutmpoint_2)
curve = Curve(toutmpolyline)
point_on_curve = PointOnCurve(curve, parameter=0.5)
getproperty = GetProperty(Obj=explode_7.KeyValues, PropName="name", Component="{ .GetProperty")
getproperty_2 = GetProperty(Obj=explode_8.KeyValues, PropName="amenity", Component="{ .GetProperty")
text_tag_3d = TextTag3D(Location=point_on_curve, Text=getproperty, Size=Slider(27, range=0..1000), Justification=7)
text_tag_3d_2 = TextTag3D(Location=point_2, Text=getproperty_2, Size=Slider(27, range=0..1000), Justification=7)
